# Grasshopper definition Arduino_ReadingData.gh (Grasshopper 1.0.7)
# plug-ins: HAL for Grasshopper, Firefly.Core

toggle = BooleanToggle(True)
open_port = OpenClosePort(OpenClosePort=toggle, PortNumber="14", BaudRate="115200")
trigger = Trigger(Interval=100, TimerInterval=100, Target=read)
write = SerialWriteGeneric(StartWritingValues=False, WriteData="115200")  # -> ArduinoOutput, StatusMessage
read = SerialReadGeneric(StartReadingValues=toggle, PortNumber="14")  # -> SerialOutput, StatusMessage
panel = Panel(read.SerialOutput)
session_settings = SessionSettings()
