# Grasshopper definition esp32.gh (Grasshopper 1.0.7)
# plug-ins: HAL for Grasshopper, Firefly.X

concat = Concatenate(FragmentA="led, ", FragmentB=Slider(0, range=0..1))
udp_sender = UDPSender(Data=concat, IPAddressOfUDPServer="192.168.1.158", UDPPort="8888")
session_settings = SessionSettings()
