# Grasshopper definition HSVP.gh (Grasshopper 1.0.7)
# plug-ins: HAL for Grasshopper, MakingMachineLegible, Firefly.Core, G E N E R A T I O N

input_ip = Data()
uranalogoutput00 = URAnalog00Reader(IP=input_ip)  # -> Log, Output
equals = Equality(FirstNumber=uranalogoutput00.Output, SecondNumber=8)  # -> Equality, Inequality
pausetrigger = PauseTrigger(Input=equals.Equality)
up = Panel(pausetrigger)

number_slider = Slider(14, range=0..100)
trigger = Trigger(Interval=10, TimerInterval=10, Target=[count, write])
count = Counter(Start=0, Step=1, Pause=Toggle(False), Reset=Toggle(False))
open_port = OpenClosePort(OpenClosePort=Toggle(True), PortNumber=number_slider, BaudRate="19200")
cluster = Cluster(S=count, G=Toggle(False), C=Slider(10, range=0..10))
item = ListItem(List=cluster, Index=0, Wrap=True)  # -> Item, Item1, Item2, Item3
# #include <FastLED.h>
# 
# #define NUM_LEDS 30
# #define DATA_PIN 6
# CRGB leds[NUM_LEDS];
# 
# // --- Tuning ---
# const unsigned long SHOW_MIN_INTERVAL_MS = 5;  // throttle screen refresh
# const uint32_t BAUD = 19200;                  // faster, more reliable than 19200
# const uint16_t PARSE_TIMEOUT_MS = 100;         // give parseInt time to read full numbers
# 
# unsigned long lastShow = 0;
# 
# void setup() {
#   Serial.begin(BAUD);
#   Serial.setTimeout(PARSE_TIMEOUT_MS);
#   FastLED.addLeds<WS2812B, DATA_PIN, GRB>(leds, NUM_LEDS);
#   FastLED.clear(true);
# }
# 
# // Eat any line endings or extra whitespace without consuming data numbers
# inline void eatTerminators() {
#   while (Serial.available()) {
#     int c = Serial.peek();
#     if (c == '\r' || c == '\n' || c == ' ' || c == '\t') {
#       Serial.read();   // discard it
#     } else {
#       break;           // next byte is part of the next number
#     }
#   }
# }
# 
# void loop() {
#   // We expect commands as:  h s v p  (e.g., "120 255 200 7\n")
#   while (Serial.available()) {
#     // Parse 4 integers; parseInt() will wait up to setTimeout() for digits
#     int h = Serial.parseInt();
#     int s = Serial.parseInt();
#     int v = Serial.parseInt();
#     int p = Serial.parseInt();
# 
#     // Clean up any CR/LF/spaces after the command so the next parse starts clean
#     eatTerminators();
# 
#     // Validate and apply
#     if (p >= 0 && p < NUM_LEDS) {
#       // clamp to 0–255 for HSV
#       h = constrain(h, 0, 255);
#       s = constrain(s, 0, 255);
#       v = constrain(v, 0, 255);
#       leds[p].setHSV((uint8_t)h, (uint8_t)s, (uint8_t)v);
#     } else {
#       Serial.println(F("ERR: pos out of bounds"));
#     }
# 
#     // Throttled show: smooth under bursty serial traffic
#     unsigned long now = millis();
#     if (now - lastShow >= SHOW_MIN_INTERVAL_MS) {
#       FastLED.show();
#       lastShow = now;
#     }
# 
#     // (Optional) ack for debugging
#     // Serial.print(F("OK p=")); Serial.print(p);
#     // Serial.print(F(" hsv=")); Serial.print(h); Serial.print(' ');
#     // Serial.print(s); Serial.print(' '); Serial.println(v);
#   }
# }
concat = Concatenate(FragmentA=item.Item, FragmentB=item.Item1, FragmentC=item.Item2, FragmentD=item.Item3, JoinSeparator=",")
write = SerialWriteGeneric(StartWritingValues=Toggle(True), WriteData=flatten(concat), PortNumber=number_slider)  # -> ArduinoOutput, StatusMessage
panel = Panel(write.ArduinoOutput)
session_settings = SessionSettings()

# ==== cluster Cluster
C = ClusterInput()
S = ClusterInput()
division = Division(A=C, B=Slider(3, range=1..10))
series = Series(Start=S, Step=1, Count=C)  # -> simplify(flatten(Series))
division_2 = Division(A=series, B=division)
round = Round(Number=division_2)  # -> Nearest, Floor, Ceiling
subtraction = Subtraction(A=division_2, B=round.Nearest)
repeat = RepeatData(Data="0", Length=C)
repeat_2 = RepeatData(Data=Slider(100, range=0..100), Length=C)
equals = Equality(FirstNumber=subtraction, SecondNumber="0")  # -> Equality, Inequality
G = ClusterInput()
rev = ReverseList(List=equals.Equality)
filter = StreamFilter(Gate=G, Stream0=equals.Equality, Stream1=rev)
repeat_3 = RepeatData(Data=Slider(210, range=0..255), Length=C)  # -> simplify(graft(Data))
repeat_4 = RepeatData(Data=Slider(211, range=0..255), Length=C)  # -> simplify(graft(Data))
p_n_c = PickNChoose(Pattern=filter, Stream0=repeat, Stream1=repeat_2)  # -> simplify(graft(Result))
int = Integer(p_n_c)
panel = Panel(subtraction)
series_2 = Series(Start=0, Step=1, Count=C)  # -> simplify(graft(Series))
merge = Merge(Data1=repeat_4, Data2=repeat_3, Data3=int)
merge_2 = Merge(Data1=merge, Data2=series_2)
int_2 = Integer(merge_2)
int_3 = ClusterOutput(int_2)
