# Grasshopper definition GH_ArduinoUno_Firefly_RGB_DelayComPort.gh (Grasshopper 1.0.7)
# plug-ins: Firefly.Core, G E N E R A T I O N

# READ ME
# Note(s): 1. Make sure the Rhino project is in "mm".
# 2. Arduino Firmata should be compiled and uploaded before using this module.
# 3. Check the Arduino IDE to confirm the Arduino port
# Tested In: 231203_In Rhino 7.0_weiwin.loy@hdr.qut.edu.au
package_s_needed = Panel("Firefly.Core, Version=1.0.0.68")

# ----
# Notes:: Check with Arduino IDE. PortNumber should reflect the port number observed in IDE.
admin_input_portnumber = Slider(11, range=0..15)
input_openarduinoport_bool = BooleanToggle(False)
input_triggercolorchanging = Button()
input_openarduinoport_bool_2 = Data(input_openarduinoport_bool)
input_triggercolorchanging_2 = Data(input_triggercolorchanging)
input_portnumber = Data(admin_input_portnumber)

# ---- group: DYNAMIC END EFFECTOR
# LOY'S OPEN SOURCE
# USER INPUTS
# USER INPUTS
# 01
# 02
ports_available = COMPortsAvailable()
# AUTOMATIC INPUTS
# Identify Arduino Port
# Establish I/O State
input_ports_available = Panel(ports_available)

# ----
# PROCESSING FUNCTIONS
# HELPERS
# COM PORT & DELAY
# 01
trigger = Trigger(Interval=100, TimerInterval=100, Target=count)
# 02
input_startplaying = Data(input_openarduinoport_bool_2)

# ----
# Delay Closing Port
count = Counter(Start=0, Step=1, Pause=False, Reset=input_startplaying)
larger = LargerThan(FirstNumber=count, SecondNumber=4)  # -> LargerThan, OrEqualTo
# MAIN FUNCTION
input_startplaying_2 = Boolean(invert(larger.LargerThan))

input_startplaying_3 = Data(input_startplaying_2)
input_portnumber_2 = Data(input_portnumber)

# ---- group: OPEN PORTS
# Opening Port and Start Playing
open_port = OpenClosePort(OpenClosePort=input_startplaying_3, PortNumber=input_portnumber_2, BaudRate=115200)
reporting = Panel(open_port)

# ----
input_triggercolorchanging_3 = Data(input_triggercolorchanging_2)
input_portnumber_3 = Data(input_portnumber)
expression = Expression(x=input_triggercolorchanging_3, y="0", z="255", Expression="if(x=true,z,y)")
expression_2 = Expression(x=input_triggercolorchanging_3, y="0", z="255", Expression="if(x=true,y,z)")

# ----
# UI / OUTPUTS
# CONTROLLING ARDUINO
# NOTES: Using 255 to indicate no color
# Using 0 to indicate full color
# NOTES: This function ensures all RGB lights are dimmed (turned off) before the serial port is closed.
# 03
# Arduino (Change Color)
input_start_close_delayed = Data(input_startplaying_2)
input_startplaying_4 = Data(input_openarduinoport_bool_2)
filter = StreamFilter(Gate=input_startplaying_4, Stream0=255, Stream1=expression_2)
filter_2 = StreamFilter(Gate=input_startplaying_4, Stream0=255, Stream1=expression)
uno_write = UnoWrite(
    StartWritingValues=input_start_close_delayed,
    DigitalPin13=0,
    DigitalPin12=0,
    DigitalPin11=0,
    DigitalPin10=0,
    DigitalPin9=0,
    DigitalPin8=0,
    DigitalPin6=filter,
    DigitalPin5=filter_2,
    DigitalPin3=filter,
    PortNumber=input_portnumber_3)  # -> ArduinoOutput, StatusMessage
panel = Panel(uno_write.ArduinoOutput)
panel_2 = Panel(uno_write.StatusMessage)
