# Grasshopper definition GH_Falsestart_230624_CreateRemoteUploadProgram.gh (Grasshopper 1.0.7)
# plug-ins: Robots, LadybugGrasshopper

# ----
# Package(s) Needed: Robot plugin.
# Ladybug plugin.
# READ ME
# Note(s): 1. Make sure the Rhino project is in "mm".
# Tested In: 230624_In Rhino 7_loyweiwin@gmail.com
# Updates and Changes: 1. Use ladybug falsestart to create a remote control system
input_ip_address = Panel()
falsestart_input_upload = LBFalseStartToggle(False)
falsestart_input_pause = LBFalseStartToggle(False)
falsestart_input_start = LBFalseStartToggle(False)

# ---- group: CONNECT YOUR ROBOT PROGRAM
# DESIGN LABS
# USER INPUTS
# AUTOMATIC INPUTS
# AUTOMATIC INPUTS
# 01
# Sent Robot Program to UR10
program = ProgramParameter()

# ----
# MAIN FUNCTION
# UI / OUTPUTS
# PROCESSING FUNCTIONS
# HELPERS
remote = RemoteConnection(
    Program=program,
    IP=input_ip_address,
    Upload=falsestart_input_upload,
    Play=falsestart_input_pause,
    Pause=falsestart_input_start)
