# Grasshopper definition GH_Firefly_230624_CreateFireflytoCommunicatewithServoMotor.gh (Grasshopper 1.0.7)
# plug-ins: Firefly.Core

# ---- group: DYNAMIC END EFFECTOR / CHECK PORT AVAILABILITY
ports_available = COMPortsAvailable()
input_ports_available = Panel(ports_available)

# ---- group: DYNAMIC END EFFECTOR / PORT STATUS
input_openport = BooleanToggle(False)
input_openport_2 = Data(input_openport)

# ---- group: DYNAMIC END EFFECTOR / PORT NUMBER
# Notes:: Check with Ports Available
input_portnumber = Slider(6, range=0..10)
input_portnumber_2 = Data(input_portnumber)

# ---- group: DYNAMIC END EFFECTOR
gripper_opengrip = BooleanToggle(False)
input_opengripper = Data(gripper_opengrip)

# ----
# READ ME
# Note(s): 1. Make sure the Rhino project is in "mm".
package_s_needed = Panel("Firefly")
# Updates and Changes: 1. Setup firefly script - communicate with servo motor.
tested_in = Panel("230624_In Rhino 7_Email")

# ----
# Note(s): // This is max rotation. Will be change once the gripper has been established.
input_maxrotation = Slider(180, range=0..180)

# ----
# AUTOMATIC INPUTS
input_opengripper_2 = Data(input_opengripper)

# ----
# DESIGN LABS
# USER INPUTS
# AUTOMATIC INPUTS
# 01
# Arduino (For DIY Gripper - Servo Motor)
input_openport_3 = Data(input_openport_2)
input_portnumber_3 = Data(input_portnumber_2)

# ---- group: BOOLEAN TOOGLE
expression = Expression(x=input_opengripper_2, y=input_maxrotation, Expression="if(x=true,0,y)")

# ---- group: CONNECT TO ARDUINO
# HELPERS
open_port = OpenClosePort(OpenClosePort=input_openport_3, PortNumber=input_portnumber_3, BaudRate=115200)
# MAIN FUNCTION
# UI / OUTPUTS
# PROCESSING FUNCTIONS
panel = Panel(open_port)

# ---- group: TALKING TO ARDUINO
uno_write = UnoWrite(
    StartWritingValues=input_openport_3,
    DigitalPin13=0,
    DigitalPin12=0,
    DigitalPin11=0,
    DigitalPin10=0,
    DigitalPin9=expression,
    DigitalPin8=0,
    DigitalPin6=0,
    DigitalPin5=0,
    DigitalPin3=0,
    PortNumber=input_portnumber_3)  # -> ArduinoOutput, StatusMessage
panel_2 = Panel(uno_write.ArduinoOutput)
