# Grasshopper definition GH_Arduino_Firefly_RGB_DelayComPort.gh (Grasshopper 1.0.7)
# Copyright: Wei Win Loy
# plug-ins: Firefly.Core, LadybugGrasshopper, Anemone, HAL for Grasshopper

# Package(s) Needed: Firefly.Core, Version=1.0.0.68
# Anemone, Version=0.4.0.0
# Ladybug.Grasshopper, Version=0.0.0.1
# READ ME
# Note(s): 1. Make sure the Rhino project is in "mm".
# 2. Arduino Firmata should be compiled and uploaded before using this module.
# 3. Check the Arduino IDE to confirm the Arduino port
# Tested In: 231203_In Rhino 7.0_weiwin.loy@hdr.qut.edu.au
updates_and_changes = Panel("""1. Insert here
2. Insert here""")

# ----
# Notes:: Check with Arduino IDE. PortNumber should reflect the port number observed in IDE.
admin_input_portnumber = Slider(7, range=0..15)
admin_input_arduinolightstartplaying = LBFalseStartToggle(False)
admin_input_senttorobot = Button()
input_uploadcmd_standard = Data(admin_input_senttorobot)
input_portnumber = Data(admin_input_portnumber)
input_startplaying = Data(admin_input_arduinolightstartplaying)

# ---- group: DYNAMIC END EFFECTOR
# LOY'S OPEN SOURCE
# USER INPUTS
# USER INPUTS
# 01
# 02
ports_available = COMPortsAvailable()
# AUTOMATIC INPUTS
# Identify Arduino Port
# Establish I/O State
input_ports_available = Panel(ports_available)

# ----
# PROCESSING FUNCTIONS
# HELPERS
# COM PORT & DELAY SHUTTING DOWN
input_portnumber_2 = Data(input_portnumber)
# MAIN FUNCTION
input_startplaying_2 = Data(input_startplaying)

# ---- group: GENERAL COMMAND LOOP
list = ValueList({"1 second": 1, "2 second": 0.5, "5 second": 0.2, "10 second": 0.1, "20 second": 0.05, "50 second": 0.02, "100 second": 0.01}, selected="2 second")
# 01
input_maxrange = Data(20)
input_startplaying_3 = Data(input_startplaying_2)
# 02
input_increaseby = Data(1)

# ---- group: GENERAL COMMAND LOOP / GH | Loop Anemone
# Turn On/Off Com Port (Delay)
division = Division(A=1, B=list)  # -> flatten(Result)
multiplication = Multiplication(A=input_maxrange, B=division)
input_maxrange_2 = Data(multiplication)
input_trigger = Data(input_startplaying_3)
input_increaseby_2 = Data(input_increaseby)
loop_start = LoopStart(Repeat=input_maxrange_2, Trigger=input_trigger, Data=0)  # -> port, Counter, Data
larger = LargerThan(FirstNumber=loop_start.Data, SecondNumber=input_maxrange_2)  # -> LargerThan, OrEqualTo
addition = Addition(A=loop_start.Data, B=input_increaseby_2)
# UI / OUTPUTS
loop_end = LoopEnd(port=loop_start.port, Exit=larger.OrEqualTo, Data=addition, TimeOutVal=0, pausedState=False, state="Constant output")

# ---- group: GENERAL COMMAND LOOP
input_increaseby_3 = Data(input_increaseby)
input_maxrange_3 = Data(input_maxrange)
subtraction = Subtraction(A=loop_end, B=input_increaseby_3)
division_2 = Division(A=subtraction, B=input_maxrange_3)

# ----
# CONTROLLING ARDUINO
input_portnumber_3 = Data(input_portnumber)

# ----
# 01
input_maxrange_4 = Data(500)
# 02
input_increaseby_4 = Data(1)
input_uploadcmdall = Data(input_uploadcmd_standard)

input_startplaying_4 = Data(input_startplaying)

# ---- group: GENERAL COMMAND LOOP
division_3 = Division(A=input_increaseby, B=list)
round = Round(Number=division_2)  # -> Nearest, Floor, Ceiling
input_startplaying_5 = Data(input_startplaying_4)
equals = Equality(FirstNumber=round.Floor, SecondNumber=division_3)  # -> Equality, Inequality
or = GateOr(A=input_startplaying_5, B=equals.Inequality)
input_startplaying_delayed = Data(or)

# ---- group: OPEN PORTS
input_startplaying_6 = Data(input_startplaying_delayed)
input_portnumber_4 = Data(input_portnumber_2)
# Opening Port and Start Playing
open_port = OpenClosePort(OpenClosePort=input_startplaying_6, PortNumber=input_portnumber_4, BaudRate=115200)
reporting = Panel(open_port)

# ----
list_2 = ValueList({"1 second": 1, "2 second": 0.5, "5 second": 0.2, "10 second": 0.1, "20 second": 0.05, "50 second": 0.02, "100 second": 0.01}, selected="1 second")
input_startplaying_7 = Data(input_startplaying_4)
input_maxrange_5 = Data(20)
# 03
input_increaseby_5 = Data(1)

# ---- group: GH | Loop Anemone
# Activate ShutDown Sequence
division_4 = Division(A=1, B=list_2)  # -> flatten(Result)
multiplication_2 = Multiplication(A=input_maxrange_5, B=division_4)
input_maxrange_6 = Data(multiplication_2)
input_trigger_2 = Data(input_startplaying_7)
input_increaseby_6 = Data(input_increaseby_5)
loop_start_2 = LoopStart(Repeat=input_maxrange_6, Trigger=input_trigger_2, Data=0)  # -> port, Counter, Data
larger_2 = LargerThan(FirstNumber=loop_start_2.Data, SecondNumber=input_maxrange_6)  # -> LargerThan, OrEqualTo
addition_2 = Addition(A=loop_start_2.Data, B=input_increaseby_6)
loop_end_2 = LoopEnd(
    port=loop_start_2.port,
    Exit=larger_2.OrEqualTo,
    Data=addition_2,
    TimeOutVal=0,
    pausedState=False,
    state="Constant output")

input_trigger_3 = Data(input_uploadcmdall)
# LED Light Timer
input_maxrange_7 = Data(input_maxrange_4)
input_increaseby_7 = Data(input_increaseby_4)
loop_start_3 = LoopStart(Repeat=input_maxrange_7, Trigger=input_trigger_3, Data=0)  # -> port, Counter, Data
larger_3 = LargerThan(FirstNumber=loop_start_3.Data, SecondNumber=input_maxrange_7)  # -> LargerThan, OrEqualTo
addition_3 = Addition(A=loop_start_3.Data, B=input_increaseby_7)
running = Running(
    port=loop_start_3.port,
    Exit=larger_3.OrEqualTo,
    Data=addition_3,
    TimeOutVal=0,
    pausedState=False,
    state="Constant output")

# ----
input_increaseby_8 = Data(input_increaseby_4)
input_maxrange_8 = Data(input_maxrange_4)
subtraction_2 = Subtraction(A=running, B=input_increaseby_8)
division_5 = Division(A=subtraction_2, B=input_maxrange_8)
input_time = Data(division_5)
equals_2 = Equality(FirstNumber=input_time, SecondNumber=1)  # -> Equality, Inequality
input_timerended = Data(equals_2.Equality)

input_portnumber_5 = Data(input_portnumber_3)
input_timerended_2 = Data(input_timerended)
expression = Expression(x=input_timerended_2, y="0", z="255", Expression="if(x=true,z,y)")
expression_2 = Expression(x=input_timerended_2, y="0", z="255", Expression="if(x=true,y,z)")

input_increaseby_9 = Data(input_increaseby_5)
input_maxrange_9 = Data(input_maxrange_5)
subtraction_3 = Subtraction(A=loop_end_2, B=input_increaseby_9)
division_6 = Division(A=subtraction_3, B=input_maxrange_9)

division_7 = Division(A=input_increaseby_5, B=list_2)
round_2 = Round(Number=division_6)  # -> Nearest, Floor, Ceiling
input_startplaying_8 = Data(input_startplaying_4)
equals_3 = Equality(FirstNumber=round_2.Floor, SecondNumber=division_7)  # -> Equality, Inequality
or_2 = GateOr(A=input_startplaying_8, B=equals_3.Inequality)
input_start_close_delayed = Data(or_2)

# ----
# Using 255 to indicate no color
# Using 0 to indicate full color
# Arduino (Change Color)
input_start_close_delayed_2 = Data(input_start_close_delayed)
input_startplaying_9 = Data(input_startplaying_4)
number_slider = Slider(255, range=0..255)
filter = StreamFilter(Gate=input_startplaying_9, Stream0=number_slider, Stream1=expression_2)
filter_2 = StreamFilter(Gate=input_startplaying_9, Stream0=number_slider, Stream1=expression)
uno_write = UnoWrite(
    StartWritingValues=input_start_close_delayed_2,
    DigitalPin13=0,
    DigitalPin12=0,
    DigitalPin11=0,
    DigitalPin10=0,
    DigitalPin9=0,
    DigitalPin8=0,
    DigitalPin6=filter,
    DigitalPin5=filter_2,
    DigitalPin3=filter,
    PortNumber=input_portnumber_5)  # -> ArduinoOutput, StatusMessage
panel = Panel(uno_write.StatusMessage)
panel_2 = Panel(uno_write.ArduinoOutput)

session_settings = SessionSettings()
