# Grasshopper definition GH_Arduino_Firefly_ReadingDistance.gh (Grasshopper 1.0.7)
# Copyright: Wei Win Loy
# plug-ins: Firefly.Core, HAL for Grasshopper

# Package(s) Needed: Firefly https://www.food4rhino.com/en/app/firefly
# READ ME
# Note(s): 1. Make sure the Rhino project is in "mm".
# 2. Arduino Firmata should be compiled and uploaded before using this module.
# 3. Check the Arduino IDE to confirm the Arduino port
# Tested In: 240120_In Rhino 7.0_weiwin.loy@hdr.qut.edu.au
# // ---------------------------------------------------------------------------
# // Example NewPing library sketch that does a ping about 20 times per second.
# // ---------------------------------------------------------------------------
# 
# #include <NewPing.h>
# 
# #define TRIGGER_PIN  12  // Arduino pin tied to trigger pin on the ultrasonic sensor.
# #define ECHO_PIN     11  // Arduino pin tied to echo pin on the ultrasonic sensor.
# #define MAX_DISTANCE 200 // Maximum distance we want to ping for (in centimeters). Maximum sensor distance is rated at 400-500cm.
# 
# NewPing sonar(TRIGGER_PIN, ECHO_PIN, MAX_DISTANCE); // NewPing setup of pins and maximum distance.
# 
# void setup() {
#   Serial.begin(115200); // Open serial monitor at 115200 baud to see ping results.
# }
# 
# void loop() {
#   delay(50);                     // Wait 50ms between pings (about 20 pings/sec). 29ms should be the shortest delay between pings.
#   Serial.print(sonar.ping_cm()); // Send ping, get distance in cm and print result (0 = outside set distance range)
#   Serial.println("cm");
# }
updates_and_changes = Panel("""1. Insert here
2. Insert here""")

# ---- group: DYNAMIC END EFFECTOR
# LOY'S OPEN SOURCE
# USER INPUTS
# USER INPUTS
# 01
ports_available = COMPortsAvailable()
# AUTOMATIC INPUTS
# HELPERS
# Identify Arduino Port
input_ports_available = Panel(ports_available)

# ---- group: DYNAMIC END EFFECTOR / PORT STATUS
input_openport = BooleanToggle(True)
input_openport_2 = Data(input_openport)

# ---- group: DYNAMIC END EFFECTOR / PORT NUMBER
# Notes:: Check with Arduino IDE. PortNumber should reflect the port number observed in IDE.
input_portnumber = Slider(3, range=0..10)
input_portnumber_2 = Data(input_portnumber)

# ----
input_userdistancewhichtriggerpause_cm = Slider(30, range=0..100)  # "INPUT_UserDistanceWhichTriggerPause (cm)_Float"
input_userdistancewhichtriggerpause_cm_2 = Integer(input_userdistancewhichtriggerpause_cm)  # "INPUT_UserDistanceWhichTriggerPause (cm)_Float"

# ----
# INTERPRETING USER DISTANCE
trigger = Trigger(Interval=500, TimerInterval=500, Target=read)

input_portnumber_3 = Data(input_portnumber_2)
# PROCESSING FUNCTIONS
# ARDUINO
# 01
input_openport_3 = Data(input_openport_2)

# ----
# MAIN FUNCTION
# Reading From Arduino Sensors
read = SerialReadGeneric(StartReadingValues=input_openport_3, PortNumber=input_portnumber_3)  # -> SerialOutput, StatusMessage
# UI / OUTPUTS
output_serialoutput = Data(read.SerialOutput)

# ----
# 01
output_serialoutput_2 = Data(output_serialoutput)

# ----
# Convert to Robot Signal
split = TextSplit(Text=output_serialoutput_2, Separators="cm")  # -> flatten(Result)
item = ListItem(List=split, Index=0, Wrap=True)
output_distance_cm = Integer(item)

output_distance_cm_2 = Integer(output_distance_cm)
input_userdistancewhichtriggerpause_cm_3 = Integer(input_userdistancewhichtriggerpause_cm_2)  # "INPUT_UserDistanceWhichTriggerPause (cm)_Float"

expression = Expression(x=output_distance_cm_2, y=input_userdistancewhichtriggerpause_cm_3, Expression="if(x=0,false,if(x>y,true,false))")
output_pauserobot_bool = Boolean(expression)

session_settings = SessionSettings()
