# Grasshopper definition GH_Arduino_Firefly_ServoMotor.gh (Grasshopper 1.0.7)
# Copyright: Wei Win Loy
# plug-ins: Firefly.Core, HAL for Grasshopper

# Package(s) Needed: Firefly https://www.food4rhino.com/en/app/firefly
# READ ME
# Note(s): 1. Make sure the Rhino project is in "mm".
# 2. Arduino Firmata should be compiled and uploaded before using this module.
# 3. Check the Arduino IDE to confirm the Arduino port
# Tested In: 230405_In Rhino 7.0_weiwin.loy@hdr.qut.edu.au
updates_and_changes = Panel("""1. Insert here
2. Insert here""")

# ---- group: DYNAMIC END EFFECTOR
# LOY'S OPEN SOURCE
# USER INPUTS
# USER INPUTS
# 01
ports_available = COMPortsAvailable()
# AUTOMATIC INPUTS
# Identify Arduino Port
input_ports_available = Panel(ports_available)

# ---- group: DYNAMIC END EFFECTOR / PORT STATUS
input_openport = BooleanToggle(False)
input_openport_2 = Data(input_openport)

# ---- group: DYNAMIC END EFFECTOR / PORT NUMBER
# Notes:: Check with Arduino IDE. PortNumber should reflect the port number observed in IDE.
# 02
input_portnumber = Slider(5, range=0..10)
input_portnumber_2 = Data(input_portnumber)

# ----
# Note(s): // This is max rotation. Will be change once the gripper has been established.
input_maxrotation = Slider(180, range=0..180)

gripper_opengrip = BooleanToggle(True)
input_servomaxrotation = Data(input_maxrotation)
# Establish I/O State
input_gripperstate = Data(gripper_opengrip)

# ----
# MAIN FUNCTION
# PROCESSING FUNCTIONS
# HELPERS
# ARDUINO
# 01
# Connecting with Arduino through Firefly
input_openport_3 = Data(input_openport_2)
input_portnumber_3 = Data(input_portnumber_2)

input_gripperstate_2 = Data(input_gripperstate)
input_servomaxrotation_2 = Data(input_servomaxrotation)

# ---- group: BOOLEAN TOOGLE
expression = Expression(x=input_gripperstate_2, y=input_servomaxrotation_2, Expression="if(x=true,0,y)")

# ---- group: CONNECT TO ARDUINO
# UI / OUTPUTS
open_port = OpenClosePort(OpenClosePort=input_openport_3, PortNumber=input_portnumber_3, BaudRate=115200)
panel = Panel(open_port)

# ---- group: TALKING TO ARDUINO
uno_write = UnoWrite(
    StartWritingValues=input_openport_3,
    DigitalPin13=0,
    DigitalPin12=0,
    DigitalPin11=0,
    DigitalPin10=0,
    DigitalPin9=expression,
    DigitalPin8=0,
    DigitalPin6=0,
    DigitalPin5=0,
    DigitalPin3=0,
    PortNumber=input_portnumber_3)  # -> ArduinoOutput, StatusMessage
# NOTES: Analog is a spectrum of value.
# Digital is a true false statement
panel_2 = Panel(uno_write.ArduinoOutput)

# ----
session_settings = SessionSettings()
