# Grasshopper definition GH_Arduino_Firefly_ReadingLux.gh (Grasshopper 1.0.7)
# Copyright: Wei Win Loy
# plug-ins: Firefly.Core

# Package(s) Needed: Firefly https://www.food4rhino.com/en/app/firefly
# READ ME
# Note(s): 1. Make sure the Rhino project is in "mm".
# 2. Arduino Firmata should be compiled and uploaded before using this module.
# 3. Check the Arduino IDE to confirm the Arduino port
# Tested In: 240120_In Rhino 7.0_weiwin.loy@hdr.qut.edu.au
updates_and_changes = Panel("""1. Insert here
2. Insert here""")

# ---- group: DYNAMIC END EFFECTOR
# LOY'S OPEN SOURCE
# USER INPUTS
# USER INPUTS
# 01
ports_available = COMPortsAvailable()
# AUTOMATIC INPUTS
# Identify Arduino Port
input_ports_available = Panel(ports_available)

# ---- group: DYNAMIC END EFFECTOR / PORT STATUS
input_openport = BooleanToggle(False)
input_openport_2 = Data(input_openport)

# ---- group: DYNAMIC END EFFECTOR / PORT NUMBER
# Notes:: Check with Arduino IDE. PortNumber should reflect the port number observed in IDE.
input_portnumber = Slider(3, range=0..10)
input_portnumber_2 = Data(input_portnumber)

# ----
input_luxlevel_lux = Slider(400, range=0..1023)
input_luxlevel_lux_trigger_number = Integer(input_luxlevel_lux)

# ----
# PROCESSING FUNCTIONS
# HELPERS
# ARDUINO
# 01
input_openport_3 = Data(input_openport_2)
input_portnumber_3 = Data(input_portnumber_2)

# ----
# INTERPRETING USER DISTANCE
trigger = Trigger(Interval=500, TimerInterval=500, Target=read)

# ----
# MAIN FUNCTION
# Reading From Arduino Sensors
read = SerialReadGeneric(StartReadingValues=input_openport_3, PortNumber=input_portnumber_3)  # -> SerialOutput, StatusMessage
# UI / OUTPUTS
output_serialoutput = Data(read.SerialOutput)

# ----
# 01
# Convert to Robot Signal
output_serialoutput_2 = Integer(output_serialoutput)
input_luxlevel_lux_trigger_number_2 = Integer(input_luxlevel_lux_trigger_number)

expression = Expression(x=output_serialoutput_2, y=input_luxlevel_lux_trigger_number_2, Expression="if(x=0,false,if(x>y,true,false))")
output_pauserobot_bool = Boolean(expression)
