# Grasshopper definition GH_ArduinoMega_Firefly_ServoMotor.gh (Grasshopper 1.0.7)
# Copyright: Wei Win Loy
# plug-ins: Firefly.Core

# ---- group: DYNAMIC END EFFECTOR
# LOY'S OPEN SOURCE
# USER INPUTS
# USER INPUTS
# Package(s) Needed: Firefly https://www.food4rhino.com/en/app/firefly
# READ ME
# Note(s): 1. Make sure the Rhino project is in "mm".
# 2. Arduino Firmata should be compiled and uploaded before using this module.
# 3. Check the Arduino IDE to confirm the Arduino port
# 01
# Tested In: 230405_In Rhino 7.0_weiwin.loy@hdr.qut.edu.au
ports_available = COMPortsAvailable()
# AUTOMATIC INPUTS
# Identify Arduino Port
input_ports_available = Panel(ports_available)

# ---- group: DYNAMIC END EFFECTOR / PORT STATUS
input_openport = BooleanToggle(True)
input_openport_2 = Data(input_openport)

# ---- group: DYNAMIC END EFFECTOR / PORT NUMBER
# Notes:: Check with Arduino IDE. PortNumber should reflect the port number observed in IDE.
# 02
input_portnumber = Slider(12, range=0..15)
input_portnumber_2 = Data(input_portnumber)

# ----
# Note(s): // This is max rotation. Will be change once the gripper has been established.
input_maxrotation_degree = Slider(180, range=0..180)

gripper_opengrip = BooleanToggle(True)
# Establish I/O State
input_gripperstate = Data(gripper_opengrip)
input_servomaxrotation = Data(input_maxrotation_degree)

input_portnumber_3 = Data(input_portnumber_2)
# MAIN FUNCTION
# PROCESSING FUNCTIONS
# HELPERS
# ARDUINO
# 01
# Connecting with Arduino through Firefly
input_openport_3 = Data(input_openport_2)

input_servomaxrotation_2 = Data(input_servomaxrotation)
input_gripperstate_2 = Data(input_gripperstate)

# ----
# NOTES: Analog is a spectrum of value.
# Digital is a true false statement
input_portnumber_4 = Data(input_portnumber_2)

# ---- group: BOOLEAN TOOGLE
expression = Expression(x=input_gripperstate_2, y=input_servomaxrotation_2, Expression="if(x=true,0,y)")

# ---- group: TALKING TO ARDUINO
mega_write = MegaWrite(
    StartWritingValues=input_openport_3,
    DigitalPin2=0,
    DigitalPin3=0,
    DigitalPin4=0,
    DigitalPin5=0,
    DigitalPin6=0,
    DigitalPin7=0,
    DigitalPin8=0,
    DigitalPin9=expression,
    DigitalPin10=0,
    DigitalPin11=0,
    DigitalPin12=0,
    DigitalPin13=0,
    DigitalPin32=0,
    DigitalPin33=0,
    DigitalPin34=0,
    DigitalPin35=0,
    DigitalPin36=0,
    DigitalPin37=0,
    DigitalPin38=0,
    DigitalPin39=0,
    DigitalPin40=0,
    DigitalPin41=0,
    DigitalPin42=0,
    DigitalPin43=0,
    DigitalPin44=0,
    DigitalPin45=0,
    DigitalPin46=0,
    DigitalPin47=0,
    DigitalPin48=0,
    DigitalPin49=0,
    DigitalPin50=0,
    DigitalPin51=0,
    DigitalPin52=0,
    DigitalPin53=0,
    PortNumber=input_portnumber_4)  # -> ArduinoOutput, StatusMessage
panel = Panel(mega_write.ArduinoOutput)

# ---- group: CONNECT TO ARDUINO
# UI / OUTPUTS
open_port = OpenClosePort(OpenClosePort=input_openport_3, PortNumber=input_portnumber_3, BaudRate=115200)
panel_2 = Panel(open_port)
